# Grasshopper definition psa.gh (Grasshopper 1.0.7)

azimuth = Slider(32.379, range=0..360)
altitude = Slider(42.062, range=0..90)
radius = Slider(5, range=5..20)
origin = ConstructPoint(XCoordinate=0, YCoordinate=0, ZCoordinate=0)
text_size = Slider(0.236, range=0..1)
colour = Colour(RGB(0, 0, 0))
point_polar = PointPolar(BasePlane=PlaneXY(0, 0, 0), XYAngle=degrees(azimuth), ZAngle=degrees(altitude), Offset=radius)
unit_z = UnitZ(Factor=1)
move = Move(Geometry=origin, Motion=unit_z)  # -> Geometry, Transform
radius_2 = Slider(0.3, range=0..1)
line = Line(StartPoint=origin, EndPoint=point_polar)
xz_plane = XZPlane(Origin=Point(0, 0, 0))
line_2 = Line(StartPoint=origin, EndPoint=move.Geometry)
arc = Arc(Plane=xz_plane, Radius=radius, Angle=Domain(0, 1.570796327))  # -> Arc, Length
circle_cnr = CircleCNR(Center=point_polar, Normal=line, Radius=radius_2)
revolution = Revolution(Curve=arc.Arc, Axis=line_2, Domain=Domain(0, 6.283185307))
extrude_point = ExtrudePoint(Base=circle_cnr, Point=origin)
multiplication = Multiplication(A=radius_2, B=0.5)
brep_brep = BrepBrep(BrepA=revolution, BrepB=extrude_point)  # -> Curves, Points
deconstruct = Deconstruct(Point=point_polar)  # -> XComponent, YComponent, ZComponent
unit_z_2 = UnitZ(Factor=1)
negative = Negative(Value=multiplication)
project = Project(Geometry=brep_brep.Curves, Plane=PlaneXY(0, 0, 0))  # -> Geometry, Transform
offset = Slider(1.604, range=-5..5)
radians = Radians(Degrees=azimuth)
construct_point = ConstructPoint(XCoordinate=deconstruct.XComponent, YCoordinate=deconstruct.YComponent, ZCoordinate=0)
radians_2 = Radians(Degrees=altitude)
vector_xyz = VectorXYZ(XComponent=negative, YComponent=negative, ZComponent=0)  # -> Vector, Length
solid_difference = SolidDifference(BrepsA=revolution, BrepsB=extrude_point)
loft = Loft(
    Curves=[brep_brep.Curves, project.Geometry],
    Options={Adjust=False, Closed=False, LoftEnds=0, LoftSimp=0, LoftType=0, Rebuild=10, Refit=0.01})
addition = Addition(A=radius, B=offset)
addition_2 = Addition(A=radius, B=offset)
line_3 = Line(StartPoint=construct_point, EndPoint=point_polar)
line_4 = Line(StartPoint=origin, EndPoint=construct_point)
length = Length(Curve=line_4)
multiplication_2 = Multiplication(A=length, B=0.5)
construct_plane = ConstructPlane(Origin=origin, XAxis=line_4, YAxis=unit_z_2)
arc_2 = Arc(Plane=PlaneXY(0, 0, 0), Radius=multiplication_2, Angle=radians)  # -> Arc, Length
arc_3 = Arc(Plane=construct_plane, Radius=multiplication_2, Angle=radians_2)  # -> Arc, Length
addition_3 = Addition(A=radius, B=offset)
plane_surface = PlaneSurface(Plane=PlaneXY(0, 0, 0), XSize=radius_2, YSize=radius_2)
addition_4 = Addition(A=construct_point, B=vector_xyz.Vector)
construct_point_2 = ConstructPoint(XCoordinate=addition, YCoordinate=0, ZCoordinate=0)
construct_point_3 = ConstructPoint(XCoordinate=0, YCoordinate=addition_2, ZCoordinate=0)
construct_point_4 = ConstructPoint(XCoordinate=0, YCoordinate=0, ZCoordinate=addition_3)
curve_middle = CurveMiddle(Curve=arc_3.Arc)
line_5 = Line([line_4, line_3])
dashes = Slider(0.178, range=0..1)
move_2 = Move(Geometry=construct_plane, Motion=curve_middle)  # -> Geometry, Transform
line_6 = Line(StartPoint=origin, EndPoint=construct_point_2)
line_7 = Line(StartPoint=origin, EndPoint=construct_point_3)
line_8 = Line(StartPoint=origin, EndPoint=construct_point_4)
brep_edges = BrepEdges(Brep=[solid_difference, loft])  # -> Naked, Interior, NonManifold
scale = Scale(Geometry=line, Center=Point(0, 0, 0), Factor=Slider(1.206, range=0.1..2))  # -> Geometry, Transform
settings_quality = SettingsQuality()
curve_middle_2 = CurveMiddle(Curve=arc_2.Arc)
move_3 = Move(Geometry=plane_surface, Motion=addition_4)  # -> Geometry, Transform
mesh_brep = MeshBrep(Brep=[solid_difference, loft], Settings=settings_quality)
dash_pattern = DashPattern(Curve=line_5, Pattern=dashes)  # -> Dashes, Gaps
text_tag_3d = TextTag3D(Location=curve_middle_2, Text="azimuth", Size=text_size, Colour=colour, Justification=7)
text_tag_3d_2 = TextTag3D(Location=move_2.Geometry, Text="altitude", Size=text_size, Colour=colour, Justification=7)
curve = Curve(brep_edges.Naked)
line_9 = Line([line_6, line_7, line_8])
line_10 = Line(scale.Geometry)
curve_2 = Curve([arc_2.Arc, arc_3.Arc])
