# Grasshopper definition radiance.gh (Grasshopper 1.0.7)

azimuth = Slider(56.361, range=0..360)
altitude = Slider(44.609, range=0..90)
radius = Slider(4.366, range=1..20)
xy_plane = XYPlane(Origin=Point(0, 0, 0))
rotate = Rotate(Geometry=xy_plane, Angle=1.570796327, Plane=PlaneXY(0, 0, 0))  # -> Geometry, Transform
negative = Negative(Value=azimuth)
text_size = Slider(0.291, range=0..1)  # disabled
colour = Colour(RGB(0, 0, 0))  # disabled
origin = ConstructPoint(XCoordinate=0, YCoordinate=0, ZCoordinate=0)
point_polar = PointPolar(BasePlane=rotate.Geometry, XYAngle=degrees(negative), ZAngle=degrees(altitude), Offset=radius)
deconstruct = Deconstruct(Point=point_polar)  # -> XComponent, YComponent, ZComponent
unit_z = UnitZ(Factor=1)
construct_point = ConstructPoint(XCoordinate=deconstruct.XComponent, YCoordinate=deconstruct.YComponent, ZCoordinate=0)
radius_2 = Slider(0.4, range=0..1)
line = Line(StartPoint=origin, EndPoint=point_polar)
radians = Radians(Degrees=altitude)
radians_2 = Radians(Degrees=negative)
circle_cnr = CircleCNR(Center=point_polar, Normal=line, Radius=radius_2)
line_2 = Line(StartPoint=construct_point, EndPoint=point_polar)
line_3 = Line(StartPoint=origin, EndPoint=construct_point)
length = Length(Curve=line_3)
multiplication = Multiplication(A=length, B=Slider(0.751, range=0..1))
construct_plane = ConstructPlane(Origin=origin, XAxis=line_3, YAxis=unit_z)
arc = Arc(Plane=construct_plane, Radius=multiplication, Angle=radians)  # -> Arc, Length
arc_2 = Arc(Plane=rotate.Geometry, Radius=multiplication, Angle=radians_2)  # -> Arc, Length
number_slider = Slider(0.842, range=0.1..2)  # disabled
curve_middle = CurveMiddle(Curve=arc.Arc)  # disabled
extrude_point = ExtrudePoint(Base=circle_cnr, Point=origin)
dashes = Slider(0.178, range=0..1)
move = Move(Geometry=construct_plane, Motion=curve_middle)  # -> Geometry, Transform; disabled
scale = Scale(Geometry=line, Center=Point(0, 0, 0), Factor=number_slider)  # -> Geometry, Transform; disabled
curve_middle_2 = CurveMiddle(Curve=arc_2.Arc)  # disabled
brep_edges = BrepEdges(Brep=extrude_point)  # -> Naked, Interior, NonManifold
settings_quality = SettingsQuality()
panel = Panel("azimuth")  # disabled
panel_2 = Panel("altitude")  # disabled
dash_pattern = DashPattern(Curve=[line_3, line_2], Pattern=dashes)  # -> Dashes, Gaps
mesh_brep = MeshBrep(Brep=extrude_point, Settings=settings_quality)
text_tag_3d = TextTag3D(Location=curve_middle_2, Text=panel, Size=text_size, Colour=colour, Justification=7)  # disabled
text_tag_3d_2 = TextTag3D(Location=move.Geometry, Text=panel_2, Size=text_size, Colour=colour, Justification=7)  # disabled
curve = Curve(brep_edges.Naked)
line_4 = Line(scale.Geometry)  # disabled

altitude_2 = Slider(58.362, range=0..90)
azimuth_2 = Slider(295.439, range=0..360)
radius_3 = Slider(5.293, range=1..20)
xy_plane_2 = XYPlane(Origin=Point(0, 0, 0))
rotate_2 = Rotate(Geometry=xy_plane_2, Angle=1.570796327, Plane=PlaneXY(0, 0, 0))  # -> Geometry, Transform
negative_2 = Negative(Value=azimuth_2)
origin_2 = ConstructPoint(XCoordinate=0, YCoordinate=0, ZCoordinate=0)
point_polar_2 = PointPolar(BasePlane=rotate_2.Geometry, XYAngle=degrees(negative_2), ZAngle=degrees(altitude_2), Offset=radius_3)
deconstruct_2 = Deconstruct(Point=point_polar_2)  # -> XComponent, YComponent, ZComponent
unit_z_2 = UnitZ(Factor=1)
construct_point_2 = ConstructPoint(XCoordinate=deconstruct_2.XComponent, YCoordinate=deconstruct_2.YComponent, ZCoordinate=0)
radians_3 = Radians(Degrees=altitude_2)
radians_4 = Radians(Degrees=negative_2)
sphere = Sphere(Base=PlaneXY(0, 0, 0), Radius=Slider(0.357, range=0..1))
line_5 = Line(StartPoint=construct_point_2, EndPoint=point_polar_2)
line_6 = Line(StartPoint=origin, EndPoint=construct_point_2)
length_2 = Length(Curve=line_6)
multiplication_2 = Multiplication(A=length_2, B=Slider(0.334, range=0..1))
construct_plane_2 = ConstructPlane(Origin=origin_2, XAxis=line_6, YAxis=unit_z_2)
arc_3 = Arc(Plane=construct_plane_2, Radius=multiplication_2, Angle=radians_3)  # -> Arc, Length
arc_4 = Arc(Plane=rotate_2.Geometry, Radius=multiplication_2, Angle=radians_4)  # -> Arc, Length
move_2 = Move(Geometry=sphere, Motion=point_polar_2)  # -> Geometry, Transform
dashes_2 = Slider(0.178, range=0..1)
mesh_brep_2 = MeshBrep(
    Brep=move_2.Geometry,
    Settings={GridMaxCount=0, GridMinCount=16, JaggedSeams=False, MaxEdgeLength=0, MinEdgeLength=0.0001, MinTolerance=0, Refine=True, RefineAngle=0, RelativeTolerance=0.65, SimplePlanes=True, Tolerance=0})
line_7 = Line(StartPoint=origin_2, EndPoint=point_polar_2)
dash_pattern_2 = DashPattern(Curve=[line_6, line_5], Pattern=dashes_2)  # -> Dashes, Gaps
mesh_colours = MeshColours(Mesh=mesh_brep_2, Colours=ColourSwatch(SwatchColor=RGB(228, 232, 19)))
line_8 = Line(line_7)

length_3 = Slider(3.033, range=1..20)
negative_3 = Negative(Value=length_3)
construct_domain = ConstructDomain(DomainStart=negative_3, DomainEnd=length_3)
plane_surface = PlaneSurface(Plane=PlaneXY(0, 0, 0), XSize=construct_domain, YSize=construct_domain)
number_slider_2 = Slider(0.814, range=0..1)
brep = Brep(plane_surface)
mesh_brep_3 = MeshBrep(
    Brep=brep,
    Settings={GridMaxCount=0, GridMinCount=16, JaggedSeams=False, MaxEdgeLength=0, MinEdgeLength=0.0001, MinTolerance=0, Refine=True, RefineAngle=0, RelativeTolerance=0.65, SimplePlanes=True, Tolerance=0})
colour_rgb_f = ColourRGBF(Alpha=Slider(0.424, range=0..1), Red=number_slider_2, Green=number_slider_2, Blue=number_slider_2)
mesh_colours_2 = MeshColours(Mesh=mesh_brep_3, Colours=colour_rgb_f)

length_4 = Slider(3.968, range=1..20)
origin_3 = ConstructPoint(XCoordinate=0, YCoordinate=0, ZCoordinate=0)
construct_point_3 = ConstructPoint(XCoordinate=length_4, YCoordinate=0, ZCoordinate=0)
construct_point_4 = ConstructPoint(XCoordinate=0, YCoordinate=length_4, ZCoordinate=0)
construct_point_5 = ConstructPoint(XCoordinate=0, YCoordinate=0, ZCoordinate=length_4)
line_9 = Line(StartPoint=origin_3, EndPoint=construct_point_3)
line_10 = Line(StartPoint=origin_3, EndPoint=construct_point_4)
line_11 = Line(StartPoint=origin_3, EndPoint=construct_point_5)
line_12 = Line([line_9, line_10, line_11])

dashes_3 = Slider(0.065, range=0..1)
dashes_4 = Slider(0.065, range=0..1)
dash_pattern_3 = DashPattern(Curve=[arc_2.Arc, arc.Arc], Pattern=dashes_3)  # -> Dashes, Gaps
dash_pattern_4 = DashPattern(Curve=[arc_4.Arc, arc_3.Arc], Pattern=dashes_4)  # -> Dashes, Gaps

origin_4 = ConstructPoint(XCoordinate=0, YCoordinate=0, ZCoordinate=0)
length_5 = Length(Curve=line)
plane_3pt = Plane3Pt(PointA=origin_4, PointB=point_polar, PointC=point_polar_2)
angle = Angle(VectorA=line, VectorB=line_8, Plane=plane_3pt)  # -> Angle, Reflex
multiplication_3 = Multiplication(A=length_5, B=Slider(0.941, range=0..1))
arc_5 = Arc(Plane=plane_3pt, Radius=multiplication_3, Angle=angle.Angle)  # -> Arc, Length
dashes_5 = Slider(0.065, range=0..1)
dash_pattern_5 = DashPattern(Curve=arc_5.Arc, Pattern=dashes_5)  # -> Dashes, Gaps
